# Grasshopper definition AssetTransferTool-FINAL.gh (Grasshopper 1.0.7)
# plug-ins: Rhino.Inside for Autodesk Revit, Human, EleFront

# ---- group: Path to Family Template
familytemplate = FilePath("C:\Users\andrew.schiffer\Desktop\use this one for the test.rft")

# ----
# Enscape Asset Transfer Tool
# By Andrew Schiffer & Jonah Hawk
yourenscapeassetlayerhere = Panel("ENTOURAGE_DS::*")
# This Definition Requires
#          Rhino.Inside.Revit
#                  Elefront
#                  Human
dynamic_geometry_pipeline = DynamicGeometryPipeline(
    LayerFilter=yourenscapeassetlayerhere,
    TypeFilter="Block",
    NameFilter="*",
    GroupByLayer=False,
    GroupByType=False,
    IncludeHidden=True,
    IncludeLocked=True,
    enableFullPath=True,
    listenToAttributes=True)
explode_blocks = ExplodeBlocks(BlockObjects=dynamic_geometry_pipeline, explodeGeom=True)  # -> Geometry, Attributes, flatten(BlockName), BoundingBox, BlockTransform, InsertionPlane, InstanceCount
create_set = CreateSet(List=explode_blocks.BlockName)  # -> Set, Map
create_tree = CreateTree(Data=explode_blocks.BlockName, Path=create_set.Map)
create_tree_2 = CreateTree(Data=explode_blocks.InsertionPlane, Path=create_set.Map)
tree_statistics = TreeStatistics(Tree=create_tree)  # -> Paths, Length, Count
list_item = ListItem(List=create_tree, Index=0, Wrap=True)
data = Data(flatten(list_item))
number_slider = Slider(1, range=0.01..1)
model = ModelCategoriesPicker({"Abutments": -2006130, "Air Systems": -2001008, "Air Terminals": -2008013, "Analysis Display Style": -2000304, "Analysis Results": -2000303, "Areas": -2003200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}, selected="Planting": -2001360)
center_box = CenterBox(Base=PlaneXY(0, 0, 0), X=number_slider, Y=number_slider, Z=number_slider)
boolean_toggle = BooleanToggle(False)
new_component_family = NewComponentFamily(
    Template=familytemplate,
    OverrideFamily=boolean_toggle,
    OverrideParameters=boolean_toggle,
    Name=data,
    Category=model,
    Geometry=center_box)  # -> flatten(Family)
get_enscape_id = GhPythonScript(block_names=flatten(data))  # -> out, EnscapeID, Missing; inputs block_names: list
# ---------- get_enscape_id: Python ----------
"""Provides a scripting component.
    Inputs:
        block_name: string value containing block name

    Output:
        out: Print a sanity check of each block, bin file and Enscape GUID
        EnscapeID: Enscape Asset GUID
        Dict: Dictionary keys. 
        """

"""
csv header order: 'Name', 'Id', 'Revision', 'Description', 'Category', 'Tags'
"""
__author__ = "jonah.hawk"
__version__ = "2021.05.17"

import re 
import os 
import clr
import csv



clr.AddReference("System.IO")
from System.Collections import IEnumerable
from System.IO import Directory, Path 


def create_name_options(name):
    name_list = [name]
    name_elements = name.split(" ")
    for i in range(0, len(name_elements)-1):
        name_elements.pop()
        print("name_elemensts: ", name_elements)
        new_name = " "
        new_name = new_name.join(name_elements)
        name_list.append(new_name)
    return name_list

def get_asset_csv_data(csv_file):
    asset_dict = {}
    with open(csv_file) as csvfile:
        asset_reader = csv.reader(csvfile, delimiter=',')
        for row in asset_reader:
            asset_dict[row[0]] = row[1]
    return asset_dict

global enscape_asset_path
enscape_asset_path = "\\\\zgf.local\\data\\ZGFResources\\3D\Enscape\\_OfflineEnscapeAssets\\"
enscape_asset_csv_path = os.path.join(enscape_asset_path, "EnscapeAssetData.csv")

if os.path.isdir(enscape_asset_path) and os.path.isfile(enscape_asset_csv_path):
    enscape_asset_key_dict = get_asset_csv_data(enscape_asset_csv_path)
    enscape_ids = []
    missing_assets = []
    
    for block_name in block_names:
        name_options = create_name_options(block_name)
        i = 0
        while i <= len(name_options):
            if i == len(name_options):
                enscape_ids.append('00000000-0000-0000-0000-00000000')
                missing_assets.append(block_name)
                break
            option = name_options[i]
            if option in enscape_asset_key_dict:
                enscape_ids.append(enscape_asset_key_dict[option])
                break
            i += 1

    EnscapeID = enscape_ids
    Missing = missing_assets
# ---------- end get_enscape_id ----------
family_types = FamilyTypes(Family=new_component_family)  # -> flatten(Types)
set_element_parameter = SetElementParameter(Element=family_types, ParameterKey="EnscapeAssetId", ParameterValue=get_enscape_id.EnscapeID)
data_2 = Data(flatten(create_tree_2))
repeat_data = RepeatData(Data=graft(set_element_parameter), Length=graft(tree_statistics.Length))  # -> flatten(Data)
add_component_location = AddComponentLocation(Location=data_2, Type=repeat_data)  # -> simplify(Component)
