# Grasshopper definition GetEnscapeIDFromBlockName_v02.gh (Grasshopper 1.0.7)
# plug-ins: Human

dynamic_geometry_pipeline = DynamicGeometryPipeline(
    LayerFilter="*",
    TypeFilter="Block",
    NameFilter="*",
    GroupByLayer=False,
    GroupByType=False,
    IncludeHidden=True,
    IncludeLocked=True,
    enableFullPath=False,
    listenToAttributes=True)
explode_blocks = ExplodeBlocks(BlockObjects=dynamic_geometry_pipeline, explodeGeom=True)  # -> Geometry, Attributes, flatten(BlockName), BoundingBox, BlockTransform, InsertionPlane, InstanceCount
panel = Panel(explode_blocks.BlockName)
get_enscape_id = GhPythonScript(block_names=flatten(panel))  # -> out, EnscapeID, Missing; inputs block_names: list
# ---------- get_enscape_id: Python ----------
"""Provides a scripting component.
    Inputs:
        block_name: string value containing block name

    Output:
        out: Print a sanity check of each block, bin file and Enscape GUID
        EnscapeID: Enscape Asset GUID
        Dict: Dictionary keys. 
        """

"""
csv header order: 'Name', 'Id', 'Revision', 'Description', 'Category', 'Tags'
"""
__author__ = "jonah.hawk"
__version__ = "2021.05.17"

import re 
import os 
import clr
import csv



clr.AddReference("System.IO")
from System.Collections import IEnumerable
from System.IO import Directory, Path 


def create_name_options(name):
    name_list = [name]
    name_elements = name.split(" ")
    for i in range(0, len(name_elements)-1):
        name_elements.pop()
        print("name_elemensts: ", name_elements)
        new_name = " "
        new_name = new_name.join(name_elements)
        name_list.append(new_name)
    return name_list

def get_asset_csv_data(csv_file):
    asset_dict = {}
    with open(csv_file) as csvfile:
        asset_reader = csv.reader(csvfile, delimiter=',')
        for row in asset_reader:
            asset_dict[row[0]] = row[1]
    return asset_dict

global enscape_asset_path
enscape_asset_path = "\\\\zgf.local\\data\\ZGFResources\\3D\Enscape\\_OfflineEnscapeAssets\\"
enscape_asset_csv_path = os.path.join(enscape_asset_path, "EnscapeAssetData.csv")

if os.path.isdir(enscape_asset_path) and os.path.isfile(enscape_asset_csv_path):
    enscape_asset_key_dict = get_asset_csv_data(enscape_asset_csv_path)
    enscape_ids = []
    missing_assets = []
    
    for block_name in block_names:
        name_options = create_name_options(block_name)
        i = 0
        while i <= len(name_options):
            if i == len(name_options):
                enscape_ids.append('00000000-0000-0000-0000-00000000')
                missing_assets.append(block_name)
                break
            option = name_options[i]
            if option in enscape_asset_key_dict:
                enscape_ids.append(enscape_asset_key_dict[option])
                break
            i += 1

    EnscapeID = enscape_ids
    Missing = missing_assets
# ---------- end get_enscape_id ----------
ghpython_script = GhPythonScript(block_names=panel)  # -> out, a; inputs block_names: list
# ---------- ghpython_script: Python ----------
__author__ = "jonah.hawk"
__version__ = "2021.05.20"

import rhinoscriptsyntax as rs
import re 
from ghpythonlib import treehelpers as th


def create_name_options(name):
    name_list = [name]
    name_elements = name.split(" ")
    for i in range(0, len(name_elements)-1):
        name_elements.pop()
        print("name_elemensts: ", name_elements)
        new_name = " "
        new_name = new_name.join(name_elements)
        name_list.append(new_name)
    return name_list
    
out_list = []
for i in block_names:
    
    name_opts = create_name_options(i)
    out_list.append(name_opts)
    
a = th.list_to_tree(out_list)
# ---------- end ghpython_script ----------
create_set = CreateSet(List=get_enscape_id.EnscapeID)  # -> Set, Map
panel_2 = Panel(ghpython_script.a)
panel_3 = Panel(create_set.Set)
panel_4 = Panel(get_enscape_id.EnscapeID)
